# Grasshopper definition test codechecker.gh (Grasshopper 1.0.9)
# plug-ins: Karamba3D

crosec = CrossSectionKaramba3D(
    FamilyNameOfCrossSection="DefaultCroSec",
    Height_cm=10,
    UpperFlangeWidth_cm=5,
    LowerFlangeWidth_cm=5,
    UpperFlangeThickness_cm=0.4,
    LowerFlangeThickness_cm=0.4,
    SidewallsThickness_cm=0.4,
    FilletRadius_cm=0.6,
    mode="Box")
xy = XYPlane(Origin=Point(0, 0, 0))
X = UnitX(Factor="3")
line = LineSDL(Start=xy, Direction=X, Length="3")
move = Move(Geometry=line, Motion=X)  # -> Geometry, Transform
lineelem = CreateLinearElementKaramba3D(
    Line=flatten([line, move.Geometry]),
    CrossSection=crosec,
    LimitDistance_m=0.005,
    BucklingLengthY_m=-1,
    BucklingLengthZ_m=-1,
    BucklingLengthLT_m=-1,
    Bending=True,
    ToPolylineMaxAngle=0.25,
    ToPolylineTolerance=0.1,
    ToPolylineMaxEdgeLength=0.25,
    New=True,
    Remove=True,
    mode="LineToBeam",
    GuidGeneratorSeed=1231336578)  # -> Element, Points, Info
Z = UnitZ(Factor=-1)
end = EndPoints(Curve=line)  # -> Start, End
Z_2 = UnitZ(Factor=-1)
lccombinator = LoadCaseCombinatorKaramba3D(LoadCaseCombinationRulesKaramba3D="ULS = (1.3|0.9)*DL+1.5*LL")  # -> LoadCaseCombinations, NamesOfLoadCases, NumberOfLoadCases
supp = SupportKaramba3D(PosInd=end.Start, Ct_kN_m=Vector(0, 0, 0), Cr_kNm_rad=Vector(0, 0, 0), menu=[buttons(on, on, on, off, off, off)])
supp_2 = SupportKaramba3D(PosInd=end.End, Ct_kN_m=Vector(0, 0, 0), Cr_kNm_rad=Vector(0, 0, 0), menu=[buttons(on, on, on, on, off, off)])
beam_loads = BeamLoadsKaramba3D(
    BeamIdentifier=lineelem.Element,
    LoadCase="DL",
    ForceVector=Z,
    TPosition="0.5",
    mode="Concentrated",
    menu=[buttons(on, off)])
beam_loads_2 = BeamLoadsKaramba3D(
    BeamIdentifier=lineelem.Element,
    LoadCase="LL",
    ForceVector=Z_2,
    TStart=0,
    TEnd=1,
    mode="Block",
    menu=[buttons(on, off, off)])
assemble = AssembleModelKaramba3D(
    Elem=lineelem.Element,
    Support=[supp, supp_2],
    Load=flatten([beam_loads_2, lccombinator.LoadCaseCombinations, beam_loads]),
    LimitDistance_m=0.005)  # -> Model, Info, Mass_kg, CentreOfGravity, LoadCaseNames
analyse = AnalyseKaramba3D(Model=assemble.Model)  # -> AnalysedModel, MaximumDisplacement_cm, ResultingForce_kN, ChangeOfElasticEnergy_kNm
py3 = Python3Script(Model=analyse.AnalysedModel, LCase="ULS", n_positions="5")  # -> out; inputs LCase: list, Beams_Ids: list of String, n_positions: Int32
# ---------- py3: Python ----------
#region import K3D
import Karamba
import Karamba.Models
import Karamba.Loads
import Karamba.Elements
import Karamba.Results
import Karamba.CrossSections
from System.Collections.Generic import List
from System import String

import locale
try:
	locale.setlocale(locale.LC_ALL, 'en_US.UTF-8')
except locale.Error:
	locale.setlocale(locale.LC_ALL, 'English_United States.1252')
import pandas as pd

#endregion
#region import codechecker
from karamba_helper import *
from code_checker import *
#endregion

Model = Model.Clone()

# get elements to be checked, if identifier provided, use the identifer, else only check linear elements
elems = []
if Beams_Ids is not None:
	elems = Model.Elements(Beams_Ids)
else:
	elems = [el for el in Model.elems if type(el).__name__ in ['ModelBeam', 'ModelTruss']]	

# get all sections and load combination permutations
all_crosecs = {sec.fe_ind(0):extract_section_properties(sec) for sec in Model.crosecs}
lc_names = expand_load_combinations(Model, LCase)


# result: [el[lc[{utilizations}]]]
for el in elems:
	elem_ind = el.ind
	sec_props = all_crosecs[el.crosec.fe_ind(0)]
	mat = sec_props['material']
	eff_len = extract_element_length(el)
	for lc_name, lc_description in lc_names:
		elemId = List[String](str(elem_ind))
		# forces/moments: list-structure: element, position, state min/max. 
		forces, moments, govLC, govLCInd, eInds = Karamba.Results.BeamForces.solve(Model, elemId, lc_name, 10000, n_positions)
		
		elem_utils = pd.DataFrame()
		for pos in range(len(forces[0])):
			fv = forces[0][pos][0]   # Vector3, single element, single LC query → forces[el=0][pos][state=0]. 
			mv = moments[0][pos][0]
			force = {'N': fv.X, 'Vy': fv.Y, 'Vz': fv.Z, 'Mx': mv.X, 'My': mv.Y, 'Mz': mv.Z}
			util = check_steel_element(sec_props, mat, eff_len, force, 1.0, 150)
			elem_utils[pos] = round(util,3)
		elem_util = elem_utils.max(axis = 1)	# get maximum along one element
		print(f'{lc_name}, element {elem_ind} \n{elem_util}')
# ---------- end py3 ----------
