# Grasshopper definition testing karamba scripts.gh (Grasshopper 1.0.9)
# plug-ins: Karamba3D

crosec = CrossSectionKaramba3D(
    FamilyNameOfCrossSection="DefaultCroSec",
    Height_cm=10,
    UpperFlangeWidth_cm=5,
    LowerFlangeWidth_cm=5,
    UpperFlangeThickness_cm=0.4,
    LowerFlangeThickness_cm=0.4,
    SidewallsThickness_cm=0.4,
    FilletRadius_cm=0.6,
    mode="Box")
xy = XYPlane(Origin=Point(0, 0, 0))
X = UnitX(Factor="3")
line = LineSDL(Start=xy, Direction=X, Length="3")
move = Move(Geometry=line, Motion=X)  # -> Geometry, Transform
crosec_2 = CrossSectionKaramba3D(
    FamilyNameOfCrossSection="DefaultCroSec",
    Height_cm=10,
    UpperFlangeWidth_cm=5,
    LowerFlangeWidth_cm=5,
    UpperFlangeThickness_cm=0.4,
    LowerFlangeThickness_cm=0.4,
    SidewallsThickness_cm=0.4,
    FilletRadius_cm=0.6,
    mode="Box")
xy_2 = XYPlane(Origin=Point(0, 0, 0))
X_2 = UnitX(Factor="3")
lineelem = CreateLinearElementKaramba3D(
    Line=flatten([line, move.Geometry]),
    CrossSection=crosec,
    LimitDistance_m=0.005,
    BucklingLengthY_m=-1,
    BucklingLengthZ_m=-1,
    BucklingLengthLT_m=-1,
    Bending=True,
    ToPolylineMaxAngle=0.25,
    ToPolylineTolerance=0.1,
    ToPolylineMaxEdgeLength=0.25,
    New=True,
    Remove=True,
    mode="LineToBeam",
    GuidGeneratorSeed=1231336578)  # -> Element, Points, Info
line_2 = LineSDL(Start=xy_2, Direction=X_2, Length="3")
move_2 = Move(Geometry=line_2, Motion=X_2)  # -> Geometry, Transform
Z = UnitZ(Factor=-1)
lcase = LoadCase("LC0")
Z_2 = UnitZ(Factor=-1)
end = EndPoints(Curve=line)  # -> Start, End
lineelem_2 = CreateLinearElementKaramba3D(
    Line=flatten([line_2, move_2.Geometry]),
    CrossSection=crosec_2,
    LimitDistance_m=0.005,
    BucklingLengthY_m=-1,
    BucklingLengthZ_m=-1,
    BucklingLengthLT_m=-1,
    Bending=True,
    ToPolylineMaxAngle=0.25,
    ToPolylineTolerance=0.1,
    ToPolylineMaxEdgeLength=0.25,
    New=True,
    Remove=True,
    mode="LineToBeam",
    GuidGeneratorSeed=626879331)  # -> Element, Points, Info
panel = Panel("""LC = LC0|LC1
ULS = (1.3|1.45)*LC0+LC""")
end_2 = EndPoints(Curve=line_2)  # -> Start, End
supp = SupportKaramba3D(PosInd=end_2.End, Ct_kN_m=Vector(0, 0, 0), Cr_kNm_rad=Vector(0, 0, 0), menu=[buttons(on, on, on, on, off, off)])
supp_2 = SupportKaramba3D(PosInd=end_2.Start, Ct_kN_m=Vector(0, 0, 0), Cr_kNm_rad=Vector(0, 0, 0), menu=[buttons(on, on, on, off, off, off)])
Z_3 = UnitZ(Factor=-1)
lcase_2 = LoadCase("LC0")
Z_4 = UnitZ(Factor=-1)
beam_loads = BeamLoadsKaramba3D(
    BeamIdentifier=lineelem_2.Element,
    LoadCase="LC1",
    ForceVector=Z_3,
    TPosition="0.5",
    mode="Concentrated",
    menu=[buttons(on, off)])
beam_loads_2 = BeamLoadsKaramba3D(
    BeamIdentifier=lineelem_2.Element,
    LoadCase=lcase_2,
    ForceVector=Z_4,
    TStart=0,
    TEnd=1,
    mode="Block",
    menu=[buttons(on, off, off)])
lccombinator = LoadCaseCombinatorKaramba3D(LoadCaseCombinationRulesKaramba3D=panel)  # -> LoadCaseCombinations, NamesOfLoadCases, NumberOfLoadCases
supp_3 = SupportKaramba3D(PosInd=end.Start, Ct_kN_m=Vector(0, 0, 0), Cr_kNm_rad=Vector(0, 0, 0), menu=[buttons(on, on, on, off, off, off)])
supp_4 = SupportKaramba3D(PosInd=end.End, Ct_kN_m=Vector(0, 0, 0), Cr_kNm_rad=Vector(0, 0, 0), menu=[buttons(on, on, on, on, off, off)])
beam_loads_3 = BeamLoadsKaramba3D(
    BeamIdentifier=lineelem.Element,
    LoadCase="LC1",
    ForceVector=Z,
    TPosition="0.5",
    mode="Concentrated",
    menu=[buttons(on, off)])
beam_loads_4 = BeamLoadsKaramba3D(
    BeamIdentifier=lineelem.Element,
    LoadCase=lcase,
    ForceVector=Z_2,
    TStart=0,
    TEnd=1,
    mode="Block",
    menu=[buttons(on, off, off)])
assemble = AssembleModelKaramba3D(
    Elem=lineelem.Element,
    Support=[supp_3, supp_4],
    Load=flatten([beam_loads_4, lccombinator.LoadCaseCombinations, beam_loads_3]),
    LimitDistance_m=0.005)  # -> Model, Info, Mass_kg, CentreOfGravity, LoadCaseNames
analyse = AnalyseKaramba3D(Model=assemble.Model)  # -> AnalysedModel, MaximumDisplacement_cm, ResultingForce_kN, ChangeOfElasticEnergy_kNm
panel_2 = Panel("""LC = LC0|LC1
ULS = (1.3|1.45)*LC0+LC""")
lccombinator_2 = LoadCaseCombinatorKaramba3D(LoadCaseCombinationRulesKaramba3D=panel_2)  # -> LoadCaseCombinations, NamesOfLoadCases, NumberOfLoadCases
assemble_2 = AssembleModelKaramba3D(
    Elem=lineelem_2.Element,
    Support=[supp_2, supp],
    Load=flatten([beam_loads_2, lccombinator_2.LoadCaseCombinations, beam_loads]),
    LimitDistance_m=0.005)  # -> Model, Info, Mass_kg, CentreOfGravity, LoadCaseNames
analyse_2 = AnalyseKaramba3D(Model=assemble_2.Model)  # -> AnalysedModel, MaximumDisplacement_cm, ResultingForce_kN, ChangeOfElasticEnergy_kNm
panel_3 = Panel("""0
0.25
0.5
0.75
1""")
panel_4 = Panel(lccombinator_2.LoadCaseCombinations)
py3 = Python3Script(Model_in=analyse_2.AnalysedModel, LCase_in=lcase_2)  # -> out; disabled
# ---------- py3: Python ----------
# --- simplest sample: extract N, V, M from a Karamba3D model --------------------
import Karamba.Models
import Karamba.Elements
import Karamba.Results
from System.Collections.Generic import List
from System import String

# model and load-case name come from Grasshopper inputs
model = Model_in.Clone()
lcName = str(LCase_in)

N_out = []   # axial force at each beam end
V_out = []   # shear force at each beam end
M_out = []   # bending moment at each beam end

elemId = List[String]([el.id for el in model.Elements()])
print([el.ind for el in model.Elements()])
forces, moments, govLC, govLCInd, eInds = Karamba.Results.BeamForces.solve(model, elemId, lcName, 10, 4)
print(len(forces[0]))
# forces  List<List<List<Vector3>>>
# translational forces: list-structure: element, position, state min/max.
print(f'first layer count:{len(govLC)}, second layer count:{len(govLC[0])}, third layer count:{len(govLC[0][0])}')
print(f'one item in the list:{type(govLC[0][0][0])} | {govLC[0][0][0]}')
# governingLoadCases  List<List<List<LoadCase>>>
# list of governing load cases.
print(list(govLCInd))
# governingLoadCaseInds  List<List<List<Int32>>>
# list of governing load case indexes.
# ---------- end py3 ----------
py3_2 = Python3Script(Model_in=analyse_2.AnalysedModel, LCase_in="ULS/min")  # -> out
# ---------- py3_2: Python ----------
# --- reveal nested list structure in Karamba3D ---------------------------------
#   results:  forces / moments  →  List<List<List<Vector3>>>
#             tier 0 = element, tier 1 = position, tier 2 = [val] or [min, max]
#   model loads:  gravity, point, uniform, mesh, temperature, strain
# --------------------------------------------------------------------------------
import Karamba.Models
import Karamba.Loads
import Karamba.Elements
import Karamba.Results
from System.Collections.Generic import List
from System import String

model = Model_in.Clone()
lcName = str(LCase_in)

# ============================  SECTION 1: Model Loads ===========================

print("\n" + "=" * 72)
print("SECTION 1 — MODEL LOADS (what's applied to the structure)")
print("=" * 72)

# ============================  SECTION 2: Results Nested Structure ==============

print("\n" + "=" * 72)
print("SECTION 2 — BeamForces.solve()  RESULTS (nested list structure)")
print("=" * 72)

elemId = List[String]([el.id for el in model.Elements()])
forces, moments, govLC, govLCInd, eInds = Karamba.Results.BeamForces.solve(
    model, elemId, lcName, 10, 4
)

# --- 2a. Type signatures -------------------------------------------------------
print("\n--- 2a. Outer type signatures")
print(f"  forces      List<List<List<Vector3>>>   len={len(forces)}")
print(f"  moments     List<List<List<Vector3>>>   len={len(moments)}")
print(f"  govLC       List<List<List<LoadCase>>>   len={len(govLC)}")
print(f"  govLCInd    List<List<List<Int32>>>       len={len(govLCInd)}")
print(f"  eInds       List<Int32>                   len={len(eInds)}")


# --- 2b. Shape drill-down ------------------------------------------------------
def state_label(n):
    """Convention: 1 state = single envelope, 2 states = [min, max]."""
    return ("single" if n == 1 else "min/max") if n <= 2 else f"{n} states"


print("\n--- 2b. Shape of each list (element → position → state)")
for elem_i in range(len(forces)):
    print(f"  Element[{elem_i}] (beam id='{elemId[elem_i]}')")
    print(f"    positions={len(forces[elem_i])}    (nodes along beam)")
    for pos_i in range(len(forces[elem_i])):
        n_states = len(forces[elem_i][pos_i])
        tag = state_label(n_states)
        for s in range(n_states):
            fv = forces[elem_i][pos_i][s]
            mv = moments[elem_i][pos_i][s]
            lc = govLC[elem_i][pos_i][s]
            lcInd = govLCInd[elem_i][pos_i][s]
            try:
                lcName = lc.Name
            except:
                lcName = "?"
            print(
                f"    pos[{pos_i}][{s}] ({tag})  "
                f"force=({fv.X:8.3f},{fv.Y:8.3f},{fv.Z:8.3f}) kN  "
                f"moment=({mv.X:8.3f},{mv.Y:8.3f},{mv.Z:8.3f}) kNm  "
                f"govLC='{lcName}' idx={lcInd}"
            )


# ============================  SECTION 3: Summary Diagram =======================

print("\n" + "=" * 72)
print("SECTION 3 — NESTED LIST DIAGRAM")
print("=" * 72)
print("""
  forces / moments  ───  List<List<List<Vector3>>>
  ═══════════════════════════════════════════════════
  Tier 0 (outer)  →  elements (beams)
  Tier 1 (middle) →  positions along beam axis
  Tier 2 (inner)  →  state (length varies):
                       • 1 entry = single envelope result
                       • 2 entries = [min, max]

  Example:  forces[2][1][0]
                   │  │  └── 1st state (min if 2‑state, else single)
                   │  └───── 2nd position point
                   └─────────── 3rd beam element

  # single-state case:
  ┌─────────────────────────────────────────┐
  │ Element 0  (beam "B1")                  │
  │   ├─ pos 0.00                           │
  │   │    └─ [0] single force  → Vector3   │
  │   ├─ pos 0.33                           │
  │   │    └─ [0] single force  → Vector3   │
  │   └─ pos 1.00                           │
  └─────────────────────────────────────────┘

  # two-state (min/max) case:
  ┌─────────────────────────────────────────┐
  │ Element 0  (beam "B1")                  │
  │   ├─ pos 0.00                           │
  │   │    ├─ [0] Min force   → Vector3     │
  │   │    └─ [1] Max force   → Vector3     │
  │   ├─ pos 0.33                           │
  │   │    ├─ [0] Min                       │
  │   │    └─ [1] Max                       │
  │   └─ pos 1.00                           │
  └─────────────────────────────────────────┘

  governing load case at the same position:
    govLC   [2][1][0]  →  LoadCase object (name, guid)
    govLCInd[2][1][0]  →  int index into model.LoadCases()
""")

print("Done — nested list structure revealed.")
# ---------- end py3_2 ----------
py3_3 = Python3Script(Model_in=analyse_2.AnalysedModel)  # -> out
# ---------- py3_3: Python ----------
# --- peel apart CroSec_Box section properties ----------------------------------
#   Access cross-section from the model, calculate all properties, dump them.
# --------------------------------------------------------------------------------
import Karamba.Models
import Karamba.CrossSections
from System import String

model = Model_in.Clone()

# ===============================================================================
# SECTION: Locate the first box cross-section
# ===============================================================================
crosecs = model.crosecs  # List[CroSec]
print(f"Total cross-sections in model: {len(crosecs)}\n")

for idx in range(len(crosecs)):
    sec = crosecs[idx]
    # The type name tells us which concrete class this is
    print(f"[{idx}]  {type(sec).__name__}  name='{sec.name}'")

    if type(sec).__name__ != "CroSec_Box":
        continue

    # ---- geometry dimensions (inherited from CroSec_I) -----------------------
    print(f"\n  ── GEOMETRY ──")
    print(f"    height      (depth)          = {sec._height:.6f}  m")
    print(f"    lf_width    (upper flange)   = {sec.lf_width:.6f}  m")
    print(f"    lf_thick    (upper flange)   = {sec.lf_thick:.6f}  m")
    print(f"    uf_width    (lower flange)   = {sec.uf_width:.6f}  m")
    print(f"    uf_thick    (lower flange)   = {sec.uf_thick:.6f}  m")
    print(f"    w_thick     (web)            = {sec.w_thick:.6f}  m")
    print(f"    fillet_r                     = {sec.fillet_r:.6f}  m")

    # ---- calculate properties from geometry ----------------------------------
    print(f"\n  ── CALCULATING PROPERTIES ──")
    print(f"    Calling sec.calculateProperties() …")
    # sec.calculateProperties()

    # ---- section properties (from CroSec_Beam) -------------------------------
    print(f"\n  ── SECTION PROPERTIES ──")

    # Area
    A = sec.A
    print(f"    A   (area)                   = {A:.10f}  m²    ({A * 1e4:.4f}  cm²)")

    # Shear areas
    Ay = sec.Ay if hasattr(sec, "Ay") else "N/A"
    Az = sec.Az if hasattr(sec, "Az") else "N/A"
    print(f"    Ay  (shear area y)           = {Ay}")
    print(f"    Az  (shear area z)           = {Az}")

    # Moments of inertia
    Iyy = sec.Iyy
    Izz = sec.Izz
    Ipp = sec.Ipp      # torsional
    Cw  = sec.Cw       # warping constant
    print(f"    Iyy (I_y)                    = {Iyy:.10f}  m⁴    ({Iyy * 1e8:.2f}  cm⁴)")
    print(f"    Izz (I_z)                    = {Izz:.10f}  m⁴    ({Izz * 1e8:.2f}  cm⁴)")
    print(f"    Ipp (I_t / torsional)        = {Ipp:.10f}  m⁴    ({Ipp * 1e8:.2f}  cm⁴)")
    print(f"    Cw  (warping)                = {Cw:.10f}  m⁶")

    # Radii of gyration
    iy = sec.iy
    iz = sec.iz
    print(f"    iy  (gyration radius y)      = {iy:.6f}  m")
    print(f"    iz  (gyration radius z)      = {iz:.6f}  m")

    # Elastic section moduli
    #  Wely_z_pos = lower fibre (+My gives tension)
    #  Wely_z_neg = upper fibre (+My gives compression)
    #  Welz_y_pos = right fibre (+Mz gives tension)
    #  Welz_y_neg = left fibre  (+Mz gives compression)
    Wely_z_pos = sec.Wely_z_pos
    Wely_z_neg = sec.Wely_z_neg
    Welz_y_pos = sec.Welz_y_pos
    Welz_y_neg = sec.Welz_y_neg
    print(f"    Wely_z_pos  (W_el,y lower)  = {Wely_z_pos:.10f}  m³  ({Wely_z_pos * 1e6:.2f}  cm³)")
    print(f"    Wely_z_neg  (W_el,y upper)  = {Wely_z_neg:.10f}  m³  ({Wely_z_neg * 1e6:.2f}  cm³)")
    print(f"    Welz_y_pos  (W_el,z right)  = {Welz_y_pos:.10f}  m³  ({Welz_y_pos * 1e6:.2f}  cm³)")
    print(f"    Welz_y_neg  (W_el,z left)   = {Welz_y_neg:.10f}  m³  ({Welz_y_neg * 1e6:.2f}  cm³)")

    # Plastic section moduli
    Wply = sec.Wply
    Wplz = sec.Wplz
    print(f"    Wply (W_pl,y)                = {Wply:.10f}  m³  ({Wply * 1e6:.2f}  cm³)")
    print(f"    Wplz (W_pl,z)                = {Wplz:.10f}  m³  ({Wplz * 1e6:.2f}  cm³)")

    # Torsional modulus
    Wt = sec.Wt
    print(f"    Wt   (torsional modulus)     = {Wt:.10f}  m³  ({Wt * 1e6:.2f}  cm³)")

    # ---- material ------------------------------------------------------------
    # NOTE: In v3.1.4, most quantities are METHODS not properties.
    #       E(direction), fy(direction), G12(), gamma(), nue12() all take ().
    #       direction=0 is the main axis for isotropic materials.
    mat = sec.material if hasattr(sec, "material") else None
    if mat is not None:
        print(f"\n  ── MATERIAL ──")
        print(f"    name            = {mat.name}")
        print(f"    family          = {mat.family}")

        # E, G, fy, fc, ft are METHODS returning kN/cm²
        E_val  = mat.E()       # kN/cm²
        G_val  = mat.G12()      # kN/cm²
        fc_val = mat.fc()      # kN/m²
        ft_val = mat.ft()      # kN/m²
        print(f"    E(0)  (Young's)       = {E_val:.1f}  kN/cm²  ({E_val * 1e4:.0f}  kN/m²)")
        print(f"    G12() (shear)        = {G_val:.1f}  kN/cm²  ({G_val * 1e4:.0f}  kN/m²)")
        print(f"    fc(0) (compress)     = {fc_val:.1f}  kN/m²")
        print(f"    ft(0) (tensile)      = {ft_val:.1f}  kN/m²")

        # nue12 and gamma are also methods
        nu_val   = mat.nue12()          # dimensionless
        gamma_val = mat.gamma()          # kN/m³
        print(f"    nue12() (Poisson's)   = {nu_val:.3f}")
        print(f"    gamma() (spec.weight) = {gamma_val:.2f}  kN/m³  ({gamma_val / 9.80665:.2f}  t/m³)")

    # ---- centroid / shear centre ---------------------------------------------
    print(f"\n  ── CENTROID & SHEAR ──")
    print(f"    zs  (centroid from top)     = {sec.zs:.6f}  m")
    print(f"    zm  (shear centre from top) = {sec.zm:.6f}  m")

    print()
    break  # only the first CroSec_Box


# ===============================================================================
# Nested structure: model → crosecs → CroSec_Box → properties
# ===============================================================================
print("\n" + "=" * 72)
print("NESTED STRUCTURE")
print("=" * 72)
print("""
  model  (Karamba.Models.Model)
   └── .crosecs    List[CroSec]       # all cross-sections
         └── [i]   CroSec_Box         # cast / check type
              ├── .height              # overall depth       [m]
              ├── .lf_width .lf_thick  # top flange           [m]
              ├── .uf_width .uf_thick  # bottom flange        [m]
              ├── .w_thick             # web thickness        [m]
              ├── .material            # FemMaterial
              ├── .calculateProperties()
              │
              ├── .A                   # area                [m²]
              ├── .Ay  .Az             # shear areas         [m²]
              ├── .Iyy .Izz .Ipp      # moments of inertia  [m⁴]
              ├── .Cw                  # warping constant    [m⁶]
              ├── .iy  .iz            # radii of gyration   [m]
              ├── .Wely_z_pos/neg     # elastic moduli y    [m³]
              ├── .Welz_y_pos/neg     # elastic moduli z    [m³]
              ├── .Wply .Wplz         # plastic moduli      [m³]
              └── .Wt                  # torsional modulus   [m³]
""")

print("Done — CroSec_Box section properties revealed.")
# ---------- end py3_3 ----------
b_forces = BeamForcesKaramba3D(AnalysedModel=analyse_2.AnalysedModel, Ts=panel_3)  # -> Model, NormalForce_kN, ShearForceVz_kN, ShearForceVy_kN, TorsionalMomentMt_kNm, BendingMomentMy_kNm, BendingMomentMz_kNm, LoadCaseIndex
panel_5 = Panel(b_forces.BendingMomentMy_kNm)
panel_6 = Panel(py3_2)
panel_7 = Panel(py3_3)
py3_4 = Python3Script(Model_in=analyse_2.AnalysedModel)  # -> out, results
# ---------- py3_4: Python ----------
# --- extract forces & moments per loadcase:  lc[element[position]] -------------
#   forces & moments separated as Vecto3  →  ready for GB50017 member checks
#   BeamForces.solve(model, elemIds, lcName, maxDist, nIntervals)
#     → out forces, moments, govLC, govLCInd, eInds
# --------------------------------------------------------------------------------
import Karamba.Models
import Karamba.Loads
import Karamba.Results
from System.Collections.Generic import List
from System import String

model = Model_in.Clone()
maxDist = 10000.0   # max distance between result points (large → uniform spacing)
nIntervals = 10     # min intervals along beam → 11 positions

# --- collect element ids --------------------------------------------------------
elemIds = List[String]([el.id for el in model.Elements()])
combNames = ['ULS']  # combination group names from Load-Case-Combinator

# --- expand combination groups → sub-LC selector strings (ULS → ULS/0, ULS/1…) ---
subLcNames = {}

for cn in combNames:
    success, lcc = model.lcActivation.TryGetLoadCaseCombination(cn)
    if success and lcc is not None:
      subLCs = lcc.LoadCases
      for subLC in subLCs:
          # format factors as "1.35*G + 1.5*Q"
          parts = []
          facs = subLC.factors
          for key in facs.Keys:
              val = facs[key]
              if abs(val) < 1e-12:
                  continue
              term = f"{val:.2f}*{key}" if abs(abs(val) - 1.0) > 1e-6 else (f"-{key}" if val < 0 else key)
              parts.append(term)
          subLcNames[subLC.Name] = f' + '.join(parts)

print(f"\nElements: {len(elemIds)}")
print(f"Sub-LCs to extract: {subLcNames}\n")


# --- extract:  result[lcName][elemIdx][posIdx] = {"f": Vector3, "m": Vector3} ---
results = {}

for lcName in subLcNames.keys():
    forces, moments, govLC, govLCInd, eInds = Karamba.Results.BeamForces.solve(
        model, elemIds, lcName, maxDist, nIntervals
    )

    lcResults = []
    for ei in range(len(forces)):
        posList = []
        for pi in range(len(forces[ei])):
            fv = forces[ei][pi][0]   # single state (no envelope for one sub-LC)
            mv = moments[ei][pi][0]
            posList.append({"f": fv, "m": mv})
        lcResults.append(posList)

    results[lcName] = lcResults
    nPos = len(forces[0]) if len(forces) > 0 else 0
    print(f"  {lcName}: {len(lcResults)} elem × {nPos} pos")


# --- print sample ---------------------------------------------------------------
if subLcNames:
    lc0 = list(subLcNames.keys())[0]
    nPos = len(results[lc0][0])
    print(f"\n--- Sample: {lc0}, element[0] '{elemIds[0]}' ---")
    for pi in range(nPos):
        fv = results[lc0][0][pi]["f"]
        mv = results[lc0][0][pi]["m"]
        print(f"  pos[{pi:2d}]  "
              f"N={fv.X:10.3f}  Vy={fv.Y:10.3f}  Vz={fv.Z:10.3f}  "
              f"Mx={mv.X:10.3f}  My={mv.Y:10.3f}  Mz={mv.Z:10.3f}")

print("\nDone — results[lc][elem][pos]['f'|'m']")
# ---------- end py3_4 ----------
py3_5 = Python3Script(Model_in=analyse_2.AnalysedModel)  # -> out
# ---------- py3_5: Python ----------
# --- extract load cases & combinations from Karamba3D model ----------------------
#   model.lcActivation  →  LoadCaseActivation (primary entry point)
#   individual LC       →  Name, factors (name→factor dict)
#   combinations         →  OR-relation of LCs, accessed by name or index
# --------------------------------------------------------------------------------
import Karamba.Models
import Karamba.Loads
# Karamba.Loads.Combination is available at runtime inside Grasshopper (unresolved here is ok)

model = Model_in.Clone()


# ============================  SECTION 1: All Load Cases =========================

print("\n" + "=" * 72)
print("SECTION 1 — INDIVIDUAL LOAD CASES  (model.lcActivation.LoadCases)")
print("=" * 72)

allLCs = model.lcActivation.LoadCases   # enumerable of LoadCase objects

for i, lc in enumerate(allLCs):
    print(f"\n  LC[{i}]  Name='{lc.Name}'")
    # lc.factors: pairs of sub-load-case-name → factor
    try:
        facs = lc.factors
        if facs is not None:
            for key in facs.Keys:
                print(f"           factor  '{key}' = {facs[key]:.3f}")
    except:
        print(f"           (no factors accessible)")


# ============================  SECTION 2: Loads per LC ===========================

print("\n" + "=" * 72)
print("SECTION 2 — LOADS ATTACHED TO EACH LC  (model.ploads, model.gravity, ...)")
print("=" * 72)

# Gravity loads
if hasattr(model, 'gravity') and model.gravity:
    for g in model.gravity:
        print(f"  Gravity   LC='{g.LcName}'  vec=({g.Force.X:.2f},{g.Force.Y:.2f},{g.Force.Z:.2f})")

# Point loads
for pl in model.ploads:
    print(f"  PointLoad LC='{pl.LcName}'  pos=({pl.Pos.X:.2f},{pl.Pos.Y:.2f},{pl.Pos.Z:.2f})  "
          f"force=({pl.Force.X:.2f},{pl.Force.Y:.2f},{pl.Force.Z:.2f})")

# Uniform loads (beam loads)
if hasattr(model, 'uloads'):
    for ul in model.uloads:
        print(f"  Uniform   LC='{ul.LcName}'  elem='{ul.BeamId}'  "
              f"vec=({ul.Vector.X:.2f},{ul.Vector.Y:.2f},{ul.Vector.Z:.2f})")


# ============================  SECTION 3: Load Combinations ======================

print("\n" + "=" * 72)
print("SECTION 3 — LOAD CASE COMBINATIONS  (model.lcActivation)")
print("=" * 72)

combNames = model.lcActivation.LoadCaseCombinationNames
print(f"  Combination count: {len(list(combNames))}")
print(f"  Names: {[str(n) for n in combNames]}")

for cname in combNames:
    cnameStr = str(cname)
    print(f"\n  Combination '{cnameStr}'")

    # --- 3a. Get the combination object ---
    success, lcc = model.lcActivation.TryGetLoadCaseCombination(cnameStr)
    if success and lcc is not None:
        try:
            # lcc.LoadCases is the list of LoadCase in this OR-combination
            for j, subLC in enumerate(lcc.LoadCases):
                print(f"    subLC[{j}]  Name='{subLC.Name}'")
                try:
                    facs = subLC.factors
                    if facs is not None:
                        for key in facs.Keys:
                            print(f"               factor  '{key}' = {facs[key]:.3f}")
                except:
                    pass
        except:
            print(f"    (could not enumerate LoadCases)")

    # --- 3b. Contribution indexes & factors ---
    try:
        contribs = model.lcActivation.ContributionIndexesFactors(cnameStr)
        if contribs is not None:
            print(f"    ContributionIndexesFactors:")
            for ci in contribs:
                print(f"      idx={ci[0]}  factor={ci[1]:.4f}")
    except Exception as e:
        print(f"    ContributionIndexesFactors: not available ({e})")


# ============================  SECTION 4: Quick Summary ==========================

print("\n" + "=" * 72)
print("SECTION 4 — SUMMARY: KEY API ENTRY POINTS")
print("=" * 72)
print("""
  model.numLC                                     → int, number of load cases
  model.lcActivation.LoadCases                     → enumerable of LoadCase
  model.lcActivation.LoadCaseCombinationNames       → list of combination name strings
  model.lcActivation.TryGetLoadCaseCombination(n)   → (bool, LoadCaseCombination)
  model.lcActivation.ContributionIndexesFactors(n)  → list of (lcIndex, factor) tuples
  lc.Name                                           → str
  lc.factors                                        → dict-like (name→factor)

  Each load object (pload, gravity, uload, ...) has .LcName → the LC it belongs to.
""")

print("Done — load cases extracted.")
# ---------- end py3_5 ----------
py3_6 = Python3Script(Model_in=analyse_2.AnalysedModel)  # -> out, results
# ---------- py3_6: Python ----------
# --- illustrate ALL cross-section properties in model ---------------------------
#   based on Karamba3D 3.1.4 API: CroSec_Beam → CroSec_Box / CroSec_I / CroSec_Circle
#   properties inherited from CroSec_Beam are available on all section types
#   units: length→mm, stress→MPa  (Karamba stores m, kN/cm² internally)
# --------------------------------------------------------------------------------
import Karamba.Models
import Karamba.CrossSections

model = Model_in

# conversion constants (Karamba internal → display)
M_TO_MM   = 1e3        # m → mm
M2_TO_MM2 = 1e6        # m² → mm²
M3_TO_MM3 = 1e9        # m³ → mm³
M4_TO_MM4 = 1e12       # m⁴ → mm⁴
M6_TO_MM6 = 1e18       # m⁶ → mm⁶
KNM2_TO_MPA  = 1e-3      # kN/m² → MPa (doc says kN/cm² but actual output is kN/m²)


# ===== COMPLETE PROPERTY REFERENCE (CroSec_Beam base class) =====================
#   Property       Field (backing)    Unit     Description
#   ─────────────  ─────────────────  ───────  ───────────────────────────────────
#   A              A_                 mm²      cross-sectional area
#   Ay             Ay_                mm²      shear area, local y-direction (horiz)
#   Az             Az_                mm²      shear area, local z-direction (vert)
#   Iyy            Iyy_               mm⁴      moment of inertia about local Y-axis
#   Izz            Izz_               mm⁴      moment of inertia about local Z-axis
#   Ipp            Ipp_               mm⁴      torsional moment of inertia (St.Venant)
#   Cw             Cw_                mm⁶      warping constant (2nd-order)
#   iy             iy_                mm       radius of gyration about y-axis
#   iz             iz_                mm       radius of gyration about z-axis
#   Wely_z_pos     Wely_z_pos_        mm³      elastic modulus y, lower fibre (+My→tension)
#   Wely_z_neg     Wely_z_neg_        mm³      elastic modulus y, upper fibre (+My→compression)
#   Welz_y_pos     Welz_y_pos_        mm³      elastic modulus z, right fibre (+Mz→tension)
#   Welz_y_neg     Welz_y_neg_        mm³      elastic modulus z, left fibre (+Mz→compression)
#   Wply           Wply_              mm³      plastic resistance moment about y-axis
#   Wplz           Wplz_              mm³      plastic resistance moment about z-axis
#   Wt             Wt_                mm³      torsional resistance moment
#   zs             Zs                 mm       COG distance from upper boundary
#   zm             —                  mm       shear centre distance from upper boundary
#   zg             Zg                 mm       load-to-shear-centre distance (default=zs)
#   alpha_y        alpha_y_           —        EC3 imperfection factor, y-direction
#   alpha_z        alpha_z_           —        EC3 imperfection factor, z-direction
#   alpha_lt       alpha_lt_          —        EC3 imperfection factor, lateral-torsional
#   product        —                  —        production type (defines alpha defaults)
#   name           —                  —        section name within family
#   family         —                  —        family group ("IPE","HEA","RHS",…)
#   familyID       —                  —        unique family identifier
#   guid           —                  —        GUID
#   country_       —                  —        country code where section is in use
#   user_defined   —                  —        True if user-defined section
#   color          —                  —        user-defined colour
#   material       —                  —        attached FemMaterial object
#   materialName   —                  —        material name string
#   dims           —                  —        section dimensions
#   nDims          —                  —        number of dimension parameters
#   nProps         —                  —        number of property parameters
#   IsValid        —                  —        True if cross-section is valid (A>0)
#   isPlausible    —                  —        True if cross-section is plausible
#   ecce_loc       eccent_            —        local eccentricity
#   hasEccent      —                  —        True if eccentricity defined
#   elemIds        elem_ids_          —        element IDs / regex this section is assigned to
#   fe_ind_        —                  —        FE model identification number
#   exteriorPerimeter —               mm        perimeter (CroSec_Box/CroSec_I override)

# ===== CroSec_Box / CroSec_I ONLY: geometry dimensions ==========================
#   Property       Field (backing)    Unit     Description
#   ─────────────  ─────────────────  ───────  ───────────────────────────────────
#   height         _height_           mm        overall depth
#   lf_width       lf_width_          mm        lower flange width
#   uf_width       uf_width_          mm        upper flange width
#   lf_thick       lf_thick_          mm        lower flange thickness
#   uf_thick       uf_thick_          mm        upper flange thickness
#   w_thick        w_thick_           mm        web thickness
#   fillet_r       fillet_r_          mm        inner fillet radius
#   fillet_r1      fillet_r1_         mm        outer fillet radius (I-section only)

# ===== FemMaterial METHODS (call with () ) ======================================
#   E(0)     → Young's modulus  [kN/m²]       G12() → shear modulus [kN/m²]
#   fy(0)    → yield strength   [kN/m²]       fu(0) → ultimate strength [kN/m²]
#   fc(0)    → compr. strength  [kN/m²]       ft(0) → tensile strength [kN/m²]
#   nue12()  → Poisson's ratio  [-]           gamma() → specific weight [kN/m³]
#   ⚠ doc says kN/cm² but actual runtime output is kN/m² → ×1e-3 for MPa


# === iterate all cross-sections in model ========================================

print("=" * 72)
print("CROSS-SECTION PROPERTIES — COMPLETE DUMP  (mm, MPa)")
print("=" * 72)

for idx, sec in enumerate(model.crosecs):
    typ = type(sec).__name__
    sec.calculateProperties()
    mat = sec.material if hasattr(sec, 'material') else None

    print(f"\n{'─'*72}")
    print(f"[{idx}]  {typ}  name='{sec.name}'  family='{sec.family if hasattr(sec,'family') else '?'}'")
    print(f"{'─'*72}")

    # --- identity ---
    print(f"\n  ── IDENTITY ──")
    for attr in ('name','family','familyID','guid','country_','user_defined',
                 'IsValid','isPlausible','nDims','nProps','fe_ind_'):
        if hasattr(sec, attr):
            print(f"  {attr:20s} = {getattr(sec, attr)}")

    # --- geometry dimensions [mm] (CroSec_Box / CroSec_I only) ---
    geo_attrs = []
    for attr in ('height','_height','lf_width','uf_width','lf_thick','uf_thick',
                 'w_thick','fillet_r','fillet_r1','exteriorPerimeter'):
        if hasattr(sec, attr):
            v = getattr(sec, attr) * M_TO_MM
            geo_attrs.append((attr, v))
    if geo_attrs:
        print(f"\n  ── GEOMETRY [mm] ──")
        for k, v in geo_attrs:
            print(f"  {k:20s} = {v:.1f}")

    # --- section properties ---
    print(f"\n  ── SECTION PROPERTIES ──")

    # area & shear [mm²]
    for attr in ('A','Ay','Az'):
        if hasattr(sec, attr):
            print(f"  {attr:20s} = {getattr(sec, attr) * M2_TO_MM2:12.0f}  mm²")

    # moments of inertia [mm⁴]
    for attr in ('Iyy','Izz','Ipp'):
        if hasattr(sec, attr):
            print(f"  {attr:20s} = {getattr(sec, attr) * M4_TO_MM4:12.0f}  mm⁴")

    # warping constant [mm⁶]
    if hasattr(sec, 'Cw'):
        print(f"  {'Cw':20s} = {sec.Cw * M6_TO_MM6:12.4e}  mm⁶")

    # radii of gyration [mm]
    for attr in ('iy','iz'):
        if hasattr(sec, attr):
            print(f"  {attr:20s} = {getattr(sec, attr) * M_TO_MM:12.1f}  mm")

    # elastic moduli [mm³]
    print(f"\n  ── ELASTIC SECTION MODULI [mm³] ──")
    for attr in ('Wely_z_pos','Wely_z_neg','Welz_y_pos','Welz_y_neg'):
        if hasattr(sec, attr):
            print(f"  {attr:20s} = {getattr(sec, attr) * M3_TO_MM3:12.0f}")

    # plastic moduli [mm³]
    print(f"\n  ── PLASTIC SECTION MODULI [mm³] ──")
    for attr in ('Wply','Wplz','Wt'):
        if hasattr(sec, attr):
            print(f"  {attr:20s} = {getattr(sec, attr) * M3_TO_MM3:12.0f}")

    # --- centroid / shear centre [mm] ---
    print(f"\n  ── CENTROID & SHEAR [mm] ──")
    for attr in ('zs','zm','zg'):
        if hasattr(sec, attr):
            print(f"  {attr:20s} = {getattr(sec, attr) * M_TO_MM:12.1f}")

    # --- buckling imperfection factors ---
    print(f"\n  ── BUCKLING (EC3) ──")
    for attr in ('alpha_y','alpha_z','alpha_lt','product'):
        if hasattr(sec, attr):
            print(f"  {attr:20s} = {getattr(sec, attr)}")

    # --- eccentricity [mm] ---
    print(f"\n  ── ECCENTRICITY [mm] ──")
    for attr in ('ecce_loc','hasEccent','elemIds'):
        if hasattr(sec, attr):
            v = getattr(sec, attr)
            if attr == 'hasEccent':
                print(f"  {attr:20s} = {v}")
            elif isinstance(v, (int, float)):
                print(f"  {attr:20s} = {v * M_TO_MM:12.1f}")
            else:
                print(f"  {attr:20s} = {v}")

    # --- material [MPa] ---
    if mat is not None:
        print(f"\n  ── MATERIAL [MPa] ──")
        print(f"  {'name':20s} = {mat.name if hasattr(mat,'name') else '?'}")
        print(f"  {'family':20s} = {mat.family if hasattr(mat,'family') else '?'}")
        try:
            print(f"  {'E(0)':20s} = {mat.E(0) * KNM2_TO_MPA:.0f}  MPa")
            print(f"  {'G12()':20s} = {mat.G12() * KNM2_TO_MPA:.0f}  MPa")
            print(f"  {'fy(0)':20s} = {mat.fy(0) * KNM2_TO_MPA:.0f}  MPa")
            if hasattr(mat, 'fu'):
                print(f"  {'fu(0)':20s} = {mat.fu(0) * KNM2_TO_MPA:.0f}  MPa")
            if hasattr(mat, 'fc'):
                print(f"  {'fc(0)':20s} = {mat.fc(0) * KNM2_TO_MPA:.0f}  MPa")
            if hasattr(mat, 'ft'):
                print(f"  {'ft(0)':20s} = {mat.ft(0) * KNM2_TO_MPA:.0f}  MPa")
            print(f"  {'nue12()':20s} = {mat.nue12():.3f}")
            print(f"  {'gamma()':20s} = {mat.gamma():.2f}  kN/m³")
        except Exception as e:
            print(f"  (material method error: {e})")

print(f"\n{'='*72}")
print("Done — all section properties illustrated  (mm, MPa).")
# ---------- end py3_6 ----------
panel_8 = Panel(py3_6.out)
panel_9 = Panel(py3_4.out)
panel_10 = Panel(py3_4.results)
panel_11 = Panel(py3_5)
disassemble = DisassembleCrossSectionKaramba3D(CroSec=crosec_2)  # -> CrossSection, FamilyNameOfCrossSection, TypeNameOfCrossSection, ElemIdentifiers, Colour, Material, LocalEccentricity_cm, Heights_cm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
panel_12 = Panel(disassemble.Iyy_cm⁴)
py3_7 = Python3Script(Model_in=analyse_2.AnalysedModel)  # -> out, results
# ---------- py3_7: Python ----------
# --- illustrate ALL cross-section properties in model ---------------------------
#   based on Karamba3D 3.1.4 API: CroSec_Beam → CroSec_Box / CroSec_I / CroSec_Circle
#   properties inherited from CroSec_Beam are available on all section types
# --------------------------------------------------------------------------------
import Karamba.Models
import Karamba.CrossSections
from Karamba.CrossSections import CroSec_Box

model = Model_in

for sec in model.crosecs:
  print(type(sec) is CroSec_Box)
# ---------- end py3_7 ----------
panel_13 = Panel(py3_7.out)
